# Grasshopper definition AutoSimu.gh (Grasshopper 1.0.7)
# plug-ins: Bifocals

# ---- group: Schedule
schedulewe = Data([0.5, 0.4375, 0.375, 0.3125, 0.3125, 0.25, 0.25, 0.375, 0.4375, 0.5625, 0.6875, 0.75, 0.8125, 0.8125, 0.75, 1, 0.8125, 0.8125, 0.9375, 1, 1, 0.9375, 0.8125, 0.625])
scheduleworking = Data([0.5, 0.4375, 0.375, 0.3125, 0.3125, 0.3125, 0.375, 0.4375, 0.5, 0.5625, 0.5625, 0.625, 0.625, 0.6875, 0.75, 0.6875, 0.8125, 0.9375, 1, 1, 0.9375, 0.875, 0.6875, 0.5625])
graph = QuickGraph(scheduleworking, SortOrder=0)
graph_2 = QuickGraph(schedulewe, SortOrder=0)
weeklyschedule = HBWeeklySchedule(
    sun=schedulewe,
    mon=scheduleworking,
    tue=scheduleworking,
    wed=scheduleworking,
    thu=scheduleworking,
    fri=scheduleworking,
    sat=schedulewe,
    holiday=schedulewe,
    summer_des=schedulewe,
    winter_des=schedulewe,
    name="Flerbostadhus_occupancy")  # -> out, schedule, idf_year, idf_week, idf_days; plug-in component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

# ----
workdays = Panel("260")
holidays = Panel("105")
ma = MassAddition(Input=scheduleworking)  # -> Result, PartialResults
ma_2 = MassAddition(Input=schedulewe)  # -> Result, PartialResults
multiplication = Multiplication(A=ma_2.Result, B=holidays)
multiplication_2 = Multiplication(A=ma.Result, B=workdays)
addition = Addition(A=multiplication_2, B=multiplication)
operation_hours = Panel(addition)

panel = Panel(schedulewe)

_1970_1980 = Panel("0.00184")
pre_1970 = Panel("0.0018")
post_2000 = Panel("0.001")
division = Division(A=post_2000, B="30")
division_2 = Division(A=pre_1970, B="20")
division_3 = Division(A=_1970_1980, B="30")

average_value_suggested_by_component = Panel("0.0003")
swe_value = Panel("0.00009")

panel_2 = Panel("""0.847848
0.847848
0.847848
0.847848
0.847848
0.847848
0.847848
0.720671
0.339877
0.221178
0.221178
0.221178
0.21657
0.221178
0.221178
0.221178
0.263571
0.440881
0.737628
0.737628
0.737628
0.847848
0.847848
0.847848""")
tenant_owned_flats = Slider(39, range=0..100)
rented_dwellings = Slider(34, range=0..100)
student_and_elders_housing = Slider(29, range=0..100)
# Determined from SVEBY
panel_3 = Panel("1")
constantschedule = HBConstantSchedule(values="80", type_limit="Activity Level")  # -> report, schedule, idf_text; plug-in component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
constantschedule_2 = HBConstantSchedule(values=panel_2)  # -> report, schedule, idf_text; plug-in component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
avr = Average(Input=[student_and_elders_housing, tenant_owned_flats, rented_dwellings])
division_4 = Division(A=panel_3, B=avr)
people = HBPeople(ppl_per_area=division_4, occupancy_sch=constantschedule_2.schedule, activity_sch=constantschedule.schedule)  # -> people; plug-in component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

# ----
# Comfort cooling is normally not avaliable
# in new dwellings (SVEBY)
panel_4 = Panel("Temperature")
constantschedule_3 = HBConstantSchedule(values="35", type_limit=panel_4)  # -> report, schedule, idf_text; plug-in component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

constantschedule_4 = HBConstantSchedule(values="22", type_limit="Temperature")  # -> report, schedule, idf_text; plug-in component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
setpoint = HBSetpoint(heating_sch=constantschedule_4.schedule, cooling_sch=constantschedule_3.schedule)  # -> setpoint; plug-in component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

household_elec_wh_m2 = Panel("30000")
lighting_portion = Panel("0.21")
division_5 = Division(A=household_elec_wh_m2, B=operation_hours)
multiplication_3 = Multiplication(A=division_5, B=lighting_portion)
lighting = HBLighting(
    watts_per_area=multiplication_3,
    schedule=weeklyschedule.schedule,
    radiant_fract="0.7",
    visible_fract="0.25",
    return_fract="0",
    baseline="11.84")  # -> lighting; plug-in component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

will_add_later_in_results = Panel("0")
servicehotwater = HBServiceHotWater(flow_per_area=will_add_later_in_results, schedule=weeklyschedule.schedule)  # -> hot_water; plug-in component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

household_elec_wh_m2_2 = Panel("30000")
division_6 = Division(A=household_elec_wh_m2_2, B=operation_hours)
multiplication_4 = Multiplication(A=division_6, B="0.79")
equipment = HBEquipment(watts_per_area=multiplication_4, schedule=weeklyschedule.schedule, radiant_fract="0.7")  # -> equip; plug-in component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

from_besti = Panel("0.00035")
ventilation = HBVentilation(flow_per_area=from_besti)  # -> vent; plug-in component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

infiltration = HBInfiltration(flow_per_ext_area=swe_value)  # -> infil; plug-in component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
programtype = HBProgramType(
    people=people,
    lighting=lighting,
    electric_equip=equipment,
    hot_water=servicehotwater,
    infiltration=infiltration,
    ventilation=ventilation,
    setpoint=setpoint)  # -> program; plug-in component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
number_slider = Slider(13, range=0..100)

# ----
# Write geoJSON path
# Mac
panel_5 = Panel("C:\OneDrive\Master_Thesis\Energy_Simulation\")
merge = Merge(Data1=panel_5)
join = TextJoin(Text=merge)
panel_6 = Panel(join)

toggle = BooleanToggle(False)

# ----
# Simulation Parameters
toggle_2 = BooleanToggle(True)
simoutput = HBSimulationOutput(zone_energy_use=toggle_2, hvac_energy_use=toggle_2, report_frequency="monthly")  # -> report, sim_output; plug-in component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
shadowcalc = HBShadowCalculation(solar_dist="FullExterior")  # -> shadow_calc; plug-in component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
simpar = HBSimulationParameter(output=simoutput.sim_output, timestep=6, shadow_calc=shadowcalc)  # -> sim_par; plug-in component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

# ---- group: PC
# Load Results
# PC
_1929 = Data("C:\OneDrive\Master_Thesis\Energy_Simulation\malmo_DH\1929\run\honeybee_scenario\Building_7_83181514\eplusout.sql")
_1971 = Data("C:\OneDrive\Master_Thesis\Energy_Simulation\malmo_DH\1971\run\honeybee_scenario\Building_8_3ab43c1c\eplusout.sql")
_1990 = Data("C:\OneDrive\Master_Thesis\Energy_Simulation\malmo_DH\1990\run\honeybee_scenario\Building_10_a90a175a\eplusout.sql")
_2000 = Data("C:\OneDrive\Master_Thesis\Energy_Simulation\malmo_DH\2000\run\honeybee_scenario\Building_11_5795787e\eplusout.sql")

# ----
_1979 = Data("C:\OneDrive\Master_Thesis\Energy_Simulation\malmo_DH\1979\run\honeybee_scenario\Building_9_8a66123a\eplusout.sql")

# ----
# Jämtlands län: https://energyplus-weather.s3.amazonaws.com/europe_wmo_region_6/SWE/SWE_Ostersund.Froson.022260_IWEC/SWE_Ostersund.Froson.022260_IWEC.zip
# Skane lan: https://energyplus-weather.s3.amazonaws.com/europe_wmo_region_6/DNK/DNK_Copenhagen.061800_IWEC/DNK_Copenhagen.061800_IWEC.zip
stockholm = Panel("https://energyplus-weather.s3.amazonaws.com/europe_wmo_region_6/SWE/SWE_Stockholm.Arlanda.024600_IWEC/SWE_Stockholm.Arlanda.024600_IWEC.zip")
data = Data(stockholm)

# ----
# Component to read building and
# archetypes information
polygon_data = GhPythonScript(building_index=Slider(3, range=0..4), path="/Users/hanxiao/Desktop/Project_Pre/Single_Buildings.xls")  # -> out, latitude, longtitude, flatten(polygon), polygon_context, floor_numbers, WWR_N, WWR_S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; inputs building_index: Int32
# ---------- polygon_data: Python ----------
import System
import math
import Grasshopper.Kernel.Data.GH_Path as GH_path
import ghpythonlib.treehelpers as th
import rhinoscriptsyntax as rs
import xlrd
from Grasshopper import DataTree
from Grasshopper.Kernel.Data import GH_Path
from Rhino.Geometry import Point3d, Polyline

wb = xlrd.open_workbook(path)
ws=wb.sheet_by_name('sheet1')
index_polygon = ws.row_values(0).index('polygon data')
index_polygonct = ws.row_values(0).index('contex polygon data')

polygon = []
polygonct = []
for i in range(1, len(ws.col_values(index_polygon))):
    polygon.append(eval(ws.col_values(index_polygon)[i]))
    polygonct.append(eval(ws.col_values(index_polygonct)[i]))



polygon = polygon[building_index]
polygonct = polygonct[building_index]

lon_comp = []
lat_comp = []
for i in range(len(polygon)):
    lon_comp.append(polygon[i][0])
    lat_comp.append(polygon[i][1])
min_lon = min(lon_comp)
min_lat = min(lat_comp)
#ref_lon, ref_lat = millerXY(min_lon, min_lat)

tree = DataTree[Point3d]()

for i in range(len(polygon)):
#        conv = millerXY(test[i][j][0], test[i][j][1])
#        conv = (conv[0]-ref_lon, conv[1]-ref_lat)
        aaa = (polygon[i][0]-min_lon, polygon[i][1]-min_lat)
        point = []
        point = rs.CreatePoint(aaa)
        newPath = GH_Path(i)
        tree.Add(point, newPath)
polygon = tree


treect = DataTree[Point3d]()
for i in range(len(polygonct)):
    for j in range(len(polygonct[i])):
#        conv = millerXY(test[i][j][0], test[i][j][1])
#        conv = (conv[0]-ref_lon, conv[1]-ref_lat)
        aaact = (polygonct[i][j][0]-min_lon, polygonct[i][j][1]-min_lat)
        pointct = []
        pointct = rs.CreatePoint(aaact)
        newPathct = GH_Path(i)
        treect.Add(pointct, newPathct)
polygon_context = treect


index_floors = ws.row_values(0).index('EgenAntalPlan')

index_WWR_N = ws.row_values(0).index('WWR_N')
index_WWR_S = ws.row_values(0).index('WWR_S')
index_WWR_V = ws.row_values(0).index('WWR_V')
index_WWR_O = ws.row_values(0).index('WWR_O')

WWR_N = ws.col_values(index_WWR_N)[1:][building_index]
WWR_S = ws.col_values(index_WWR_S)[1:][building_index]
WWR_V = ws.col_values(index_WWR_V)[1:][building_index]
WWR_O = ws.col_values(index_WWR_O)[1:][building_index]

floor_height = ws.col_values(ws.row_values(0).index('Average floor height'))[1:][building_index]

U_wall = ws.col_values(ws.row_values(0).index('U-wall'))[1:][building_index]
U_window = ws.col_values(ws.row_values(0).index('U_widnows'))[1:][building_index]
U_ground = ws.col_values(ws.row_values(0).index('U-ground'))[1:][building_index]
U_roof = ws.col_values(ws.row_values(0).index('U_roof'))[1:][building_index]
floor_numbers = ws.col_values(index_floors)[1:][building_index]

if ws.col_values(ws.row_values(0).index('Atemp convert factor'))[1] < 1:
    Scale_factor = ws.col_values(ws.row_values(0).index('Atemp convert factor'))[1]
else:
    Scale_factor =1

Year = ws.col_values(ws.row_values(0).index('EgenNybyggAr'))[1:][building_index]

Aprt_Nr = ws.col_values(ws.row_values(0).index('EgenAntalBolgh'))[1:][building_index]

latitude = ws.col_values(ws.row_values(0).index('latitude'))[1:][building_index]

longtitude = ws.col_values(ws.row_values(0).index('longtitude'))[1:][building_index]

Lan = ws.col_values(ws.row_values(0).index('IdLan'))[1:][building_index]
# ---------- end polygon_data ----------

panel_7 = Panel(polygon_data.Lan)

panel_8 = Panel(polygon_data.polygon)

# ---- group: Polygon data
# Building footprint polygon
panel_9 = Panel(polygon_data.polygon)
pline = PolyLine(Vertices=panel_9, Closed=False)
brep = Brep(pline)

# ----
item = ListItem(List=polygon_data.longtitude, Index=0, Wrap=True)
item_2 = ListItem(List=polygon_data.latitude, Index=0, Wrap=True)

# ----
# Context generation
pline_2 = PolyLine(Vertices=polygon_data.polygon, Closed=False)
pline_3 = PolyLine(Vertices=polygon_data.polygon_context, Closed=False)
equals = Equality(FirstNumber=pline_2, SecondNumber=pline_3)  # -> Equality, Inequality
cull = CullPattern(List=pline_3, CullPattern=equals.Inequality)
multiplication_5 = Multiplication(A=polygon_data.floor_numbers, B=polygon_data.floor_height)
context = Brep(cull)
Z = UnitZ(Factor=multiplication_5)
extr = Extrude(Base=context, Direction=Z)  # -> flatten(Extrusion)

number_of_stories = Panel(polygon_data.floor_numbers)
scale_factor = Panel(polygon_data.Scale_factor)
floor_height = Panel(polygon_data.floor_height)

# ----
# Construction Set
number_slider_2 = Slider(1, range=0..1)
division_7 = Division(A=number_slider_2, B=graft(polygon_data.U_wall))
division_8 = Division(A=Slider(1, range=0..1), B=graft(polygon_data.U_ground))
division_9 = Division(A=Slider(1, range=0..1), B=graft(polygon_data.U_roof))
opaquematnomass = HBOpaqueMaterialNoMass(r_value=division_7)  # -> mat; plug-in component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
windowmat = HBWindowMaterial(u_factor=graft(polygon_data.U_window), shgc=Slider(0.5, range=0..1))  # -> mat; plug-in component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
opaquematnomass_2 = HBOpaqueMaterialNoMass(r_value=division_8)  # -> mat; plug-in component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
opaquematnomass_3 = HBOpaqueMaterialNoMass(r_value=division_9)  # -> mat; plug-in component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
opaqueconstr = HBOpaqueConstruction(materials=opaquematnomass)  # -> constr; plug-in component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
opaqueconstr_2 = HBOpaqueConstruction(materials=opaquematnomass_2)  # -> constr; plug-in component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
windowconstr = HBWindowConstruction(materials=windowmat)  # -> constr; plug-in component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
opaqueconstr_3 = HBOpaqueConstruction(materials=opaquematnomass_3)  # -> constr; plug-in component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
subfacesubset = HBSubfaceSubset(window=windowconstr)  # -> subface_set; plug-in component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
exteriorsubset = HBExteriorConstructionSubset(exterior_wall=opaqueconstr, exterior_roof=opaqueconstr_3, exposed_floor=opaqueconstr_2)  # -> exterior_set; plug-in component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
constructionset = HBConstructionSet(exterior_subset=exteriorsubset, subface_subset=subfacesubset)  # -> constr_set; plug-in component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

# ----
# Scale building footprints
atempt_scale_factor = SquareRoot(Value=scale_factor)
area = Area(Geometry=brep)  # -> Area, Centroid
scale = Scale(Geometry=brep, Center=area.Centroid, Factor=atempt_scale_factor)  # -> Geometry, Transform
area_2 = Area(Geometry=scale.Geometry)  # -> Area, Centroid
ma_3 = MassAddition(Input=flatten(area.Area))  # -> Result, PartialResults
ma_4 = MassAddition(Input=flatten(area_2.Area))  # -> Result, PartialResults
panel_10 = Panel(ma_3.Result)
panel_11 = Panel(ma_4.Result)

# ----
# Building stories Heights series
perimeter_depth_m = Panel("10")
dup = DuplicateData(Data=graft(floor_height), Number=graft(number_of_stories), Order=True)
panel_12 = Panel(dup)

decnstrconstrset = HBDeconstructConstructionSet(constr_set=constructionset)  # -> exterior_wall, exterior_roof, exposed_floor, ground_wall, ground_roof, ground_floor, window, skylight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; plug-in component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
panel_13 = Panel(decnstrconstrset.ground_floor)

# ----
# Create Buildings
buildingfootprint = DFBuildingFromFootprint(footprint_geo=scale.Geometry, floor_to_floor=dup, program=programtype, constr_set=constructionset, run=Toggle(True))  # -> report, buildings; plug-in component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
topbottom = DFSeparateTopBottom(buildings=buildingfootprint.buildings)  # -> simplify(buildings); plug-in component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

decnstrconstr = HBDeconstructConstruction(constr=decnstrconstrset.ground_floor)  # -> materials, layers, r_val_si, r_val_ip, u_fac_si, u_fac_ip, shgc, t_sol, t_vis; plug-in component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
panel_14 = Panel(decnstrconstr.u_fac_si)
vizall = DFVisualizeAll(df_objs=flatten(buildingfootprint.buildings))  # -> geo; plug-in component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

# ----
# Assign Windows
facparam = HBFacadeParameters(north=polygon_data.WWR_N, east=polygon_data.WWR_O, south=polygon_data.WWR_S, west=polygon_data.WWR_V)  # -> fac_par; plug-in component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
simpleratiopar = DFSimpleWindowRatioParameters(ratio=facparam)  # -> simplify(win_par); plug-in component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
applyfacadepar = DFApplyFacadeParameters(df_obj=topbottom, win_par=simpleratiopar)  # -> report, df_obj; plug-in component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

# ----
# Ventilation
dfidealair = DFIdealAir(df_objs=flatten(applyfacadepar.df_obj))  # -> report, df_objs; plug-in component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

context_2 = DFContextShade(geo=extr)  # -> report, context; plug-in component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

# ----
# Write geoJSON path
# PC
panel_15 = Panel("C:\OneDrive\Master_Thesis\Energy_Simulation\malmo_DH\")
merge_2 = Merge(Data1=panel_15, Data2=polygon_data.Year)
join_2 = TextJoin(Text=merge_2)
panel_16 = Panel(join_2)

vizall_2 = DFVisualizeAll(df_objs=flatten(dfidealair.df_objs))  # -> geo; plug-in component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
vizall_3 = DFVisualizeAll(df_objs=flatten(dfidealair.df_objs))  # -> geo; plug-in component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

# ----
# Create Model
model = DFModel(buildings=flatten(dfidealair.df_objs), context=flatten(context_2.context))  # -> report, model; plug-in component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

# ----
# Visualize model in HB Room
toggle_3 = BooleanToggle(False)
tohoneybee = DFModelToHoneybee(model=model.model, obj_per_model="District", use_multiplier=toggle_3, shade_dist="50", run=Toggle(True))  # -> report, hb_models; plug-in component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
vizbytype = HBVisualizeByType(hb_objs=tohoneybee.hb_models)  # -> walls, interior_walls, roofs, ceilings, exterior_floors, interior_floors, air_walls, apertures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; plug-in component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

# ----
# Visualize Model Properties
room2dattr = DFRoom2DAttributes({"Display Name": "display_name", "Simulation Name (Identifier)": "identifier", "Floor-To-Ceiling Height": "floor_to_ceiling_height", "Floor Elevation": "floor_height", "Ceiling Elevation": "ceiling_height", "Is Ground Contact": "is_ground_contact"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}, selected="Occupancy Schedule": "properties.energy.program_type.people.occupancy_schedule.display_name")
data_2 = Data(flatten(model.model))
colorroom2dattr = DFColorRoom2DAttributes(df_obj=flatten(data_2), attribute=room2dattr)  # -> mesh, legend, wire_frame, values, colors; plug-in component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

vizall_4 = DFVisualizeAll(df_objs=flatten(model.model))  # -> geo; plug-in component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

# ----
# Write geoJSON
panel_17 = Panel("1")
vec = VectorXYZ(XComponent=0, YComponent=0, ZComponent=0)  # -> Vector, Length
constrloc = LBConstructLocation(latitude=item_2, longitude=item, time_zone=panel_17, elevation=0)  # -> location; plug-in component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
pt = Point(vec.Vector)
togeojson = DFModelToGeoJSON(
    model=model.model,
    location=constrloc,
    point=pt,
    use_multiplier=Toggle(True),
    ceil_adjacency=Toggle(True),
    shade_dist="50",
    write=Toggle(False))  # -> report, geojson, hb_jsons, hb_models; plug-in component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

# ----
# Download EPW File
downloadepw = LBDownloadWeather(weather_URL=data)  # -> epw_file, stat_file, ddy_file; plug-in component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

modeltoosm = HBModelToOSM(model=tohoneybee.hb_models, epw_file=downloadepw.epw_file, sim_par=simpar, write=toggle, run=toggle)  # -> report, jsons, osw, osm, idf, sql, zsz, rdd, html; plug-in component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

# ----
# Compute EUI
eui = HBEndUseIntensity(sql=modeltoosm.sql)  # -> eui, eui_end_use, end_uses, gross_floor; plug-in component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
panel_18 = Panel(eui.eui_end_use)
panel_19 = Panel(eui.end_uses)

item_3 = ListItem(List=eui.eui_end_use, Index=0, Wrap=True)

# ----
# GWP/m2
# District Heating
item_4 = ListItem(List=item_3, Index=0, Wrap=True)
hot_water_kwh = Panel("25")
multiplication_6 = Multiplication(A=item_4)
addition_2 = Addition(A=multiplication_6, B=hot_water_kwh)
panel_20 = Panel(addition_2)
division_10 = Division(A=addition_2, B="100000")
multiplication_7 = Multiplication(A=division_10, B="60")
dh_gwp_kg_co2_e_mwh = Panel(multiplication_7)

# ----
# Run Simulation
runurbanopt = DFRunURBANopt(geojson=togeojson.geojson, epw_file=downloadepw.epw_file, sim_par=simpar, run=Toggle(False))  # -> report, scenario, osm, idf, sql, zsz, rdd, html; plug-in component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

data_3 = Data(runurbanopt.sql)
data_4 = Data(data_3)

# ----
# Compute EUI
toggle_4 = BooleanToggle(False)
eui_2 = HBEndUseIntensity(sql=data_4, ip=toggle_4)  # -> eui, eui_end_use, end_uses, gross_floor; plug-in component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
eui_kbtu_ft2 = Panel(eui_2.eui)
panel_21 = Panel(eui_2.eui_end_use)
panel_22 = Panel(eui_2.end_uses)

panel_23 = Panel(eui_2.gross_floor)

# ----
# Visualize Energy Use in Chart
roomenergyresult = HBReadRoomEnergyResult()  # -> cooling, heating, lighting, electric_equip, gas_equip, process, hot_water, fan_electric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; plug-in component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
massarithop = LBMassArithmeticOperation(data=flatten(roomenergyresult.hot_water), type="Hot Water")  # -> data; plug-in component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
massarithop_2 = LBMassArithmeticOperation(data=flatten(roomenergyresult.gas_equip), type="Gas Equipment")  # -> data; plug-in component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
massarithop_3 = LBMassArithmeticOperation(data=flatten(roomenergyresult.fan_electric), type="Fans")  # -> data; plug-in component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
massarithop_4 = LBMassArithmeticOperation(data=flatten(roomenergyresult.heating), type="Heating")  # -> data; plug-in component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
massarithop_5 = LBMassArithmeticOperation(data=flatten(roomenergyresult.pump_electric), type="Pumps")  # -> data; plug-in component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
massarithop_6 = LBMassArithmeticOperation(data=flatten(roomenergyresult.electric_equip), type="Electric Equipment")  # -> data; plug-in component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
massarithop_7 = LBMassArithmeticOperation(data=flatten(roomenergyresult.cooling), type="Cooling")  # -> data; plug-in component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
massarithop_8 = LBMassArithmeticOperation(data=flatten(roomenergyresult.lighting), type="Lighting")  # -> data; plug-in component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
normalize = LBAreaNormalize(
    data=[massarithop_7, massarithop_4, massarithop_8, massarithop_6, massarithop_2, massarithop, massarithop_3, massarithop_5],
    area=eui_2.gross_floor,
    unit="m2")  # -> data; plug-in component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
legendpar = LBLegendParameters(
    seg_count="9",
    colors=[ColourSwatch(SwatchColor=RGB(0, 136, 255)), ColourSwatch(SwatchColor=RGB(255, 0, 0)), ColourSwatch(SwatchColor=RGB(255, 251, 0)), ColourSwatch(SwatchColor=RGB(255, 157, 0)), ColourSwatch(SwatchColor=RGB(255, 106, 0)), ColourSwatch(SwatchColor=RGB(153, 0, 0)), ColourSwatch(SwatchColor=RGB(204, 204, 204)), ColourSwatch(SwatchColor=RGB(76, 76, 76))],
    num_decimals="0")  # -> leg_par; plug-in component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
monthlychart = LBMonthlyChart(data=normalize, stack=Toggle(True), global_title="Proposed Design", legend_par=legendpar)  # -> report, data_mesh, data_lines, col_lines, legend, borders, labels, y_title, title; plug-in component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

multiplication_8 = Multiplication(A=eui_kbtu_ft2, B=panel_23)
panel_24 = Panel(multiplication_8)

# ----
# GWP/m2
# Electricity
panel_25 = Panel("""1
2""")
item_5 = ListItem(List=panel_21, Index=panel_25, Wrap=True)
multiplication_9 = Multiplication(A=item_5)
ma_5 = MassAddition(Input=multiplication_9)  # -> Result, PartialResults
panel_26 = Panel(ma_5.Result)
division_11 = Division(A=ma_5.Result, B="100000")
multiplication_10 = Multiplication(A=division_11, B="22")
elec_gwp_kg_co2_e_mwh = Panel(multiplication_10)

# ----
# GWP/m2
# District Heating
item_6 = ListItem(List=panel_21, Index=0, Wrap=True)
hot_water_kwh_2 = Panel("25")
multiplication_11 = Multiplication(A=item_6)
addition_3 = Addition(A=multiplication_11, B=hot_water_kwh_2)
panel_27 = Panel(addition_3)
division_12 = Division(A=addition_3, B="100000")
multiplication_12 = Multiplication(A=division_12, B="60")
dh_gwp_kg_co2_e_mwh_2 = Panel(multiplication_12)
